# Grasshopper definition continuum_robot.gh (Grasshopper 1.0.8)
# plug-ins: Cushion.Components

tendon_offset = Slider(0.74, range=0.01..1)
number_slider = Slider(1, range=0..1)
radius = Slider(8, range=0..100)
length = Slider(100, range=0..100)
refresh_sofapreview = Button()
refresh_sofaresults = Button()
write_sofascene = BooleanToggle(True)
runsofa = Button()
panel = Panel("""0
120
240""")
construct_domain = ConstructDomain(DomainStart=0, DomainEnd=1)
tendon_value_type = Panel("force")
multiplication = Multiplication(A=radius, B=tendon_offset)
# Set Project Directory
project_directory = Panel("C:\Users\texley\OneDrive - Fondazione Istituto Italiano Tecnologia\3D Files\sofaGH\sofatest")
# Set runSofa Location
body_name = Panel("trunk")
# Set Repository
repository = Panel("C:\Users\texley\OneDrive - Fondazione Istituto Italiano Tecnologia\3D Files\sofaGH\sofa-gh")
range = Range(Domain=construct_domain, Steps=10)
runsofa_location = Panel("C:\SOFA\v24.06.00\bin")
expression = Expression(t=range, p=graft(panel), r=multiplication, k=number_slider, Expression="r * cos(2*pi*k*t + rad(p))")
expression_2 = Expression(t=range, p=graft(panel), r=multiplication, k=number_slider, Expression="r * sin(2*pi*k*t + rad(p))")
cylinder = Cylinder(Base=PlaneXY(0, 0, 0), Radius=radius, Length=length)
expression_3 = Expression(t=range, L=length, Expression="L*t")
point = Point(Point(0, 0, 0))
cap_holes = CapHoles(Brep=cylinder)
line_sdl = LineSDL(Start=point, Direction=Vector(0, 0, 1), Length=length)

# ----
# Define fixation
number_slider_2 = Slider(2, range=0..10)
number_slider_3 = Slider(15, range=0..100)
point_2 = Point(Point(0, 0, 2))
center_box = CenterBox(Base=point_2, X=number_slider_3, Y=number_slider_3, Z=number_slider_2)

construct_point = ConstructPoint(XCoordinate=expression, YCoordinate=expression_2, ZCoordinate=expression_3)
quad_remesh_settings = QuadRemeshSettings(TargetCount=1000, AdaptiveSize=0, AdaptiveCount=False, HardEdges=False, SeamEdges=0, Symmetry=0, GuideCurves=0)
divide_curve = DivideCurve(Curve=line_sdl, Count=10, Kinks=False)  # -> Points, Tangents, Parameters
quad_remesh = QuadRemesh(Geometry=cap_holes, Settings=quad_remesh_settings)
panel_2 = Panel("""0,0,-5
0,0,-5
0,0,-5""")
panel_3 = Panel("""1
2
3""")
panel_4 = Panel("""0
1000
0""")
sofatendons = SofaTendons(Pts=construct_point, Channels=panel_3, ValueType=tendon_value_type, PullPoints=panel_2)  # -> Tendons, Info
panel_5 = Panel("""2
2.5
3""")
panel_6 = Panel("""1
1.5
2""")
panel_7 = Panel("""0
0.5
1""")
entwine = Entwine(Branch00=panel_4, Branch01=panel_4, Branch02=panel_4, FlattenInputs=True)
entwine_2 = Entwine(Branch00=panel_7, Branch01=panel_6, Branch02=panel_5, FlattenInputs=True)
young_s_modulus = Slider(100, range=10..100)
nu = Slider(0.4, range=0.1..1)
mass = Slider(0.03, range=0.01..0.5)
meshsize = Slider(0.6, range=0..1)
sofaprofiles = SofaProfiles(Channels=panel_3, Times=entwine_2, Values=entwine)  # -> Profiles, Info
sofabody = SofaBody(
    Geo=quad_remesh,
    Name=body_name,
    E=young_s_modulus,
    Nu=nu,
    Mass=mass,
    MeshSize=meshsize,
    Tendons=sofatendons.Tendons,
    Fixations=center_box,
    MonitorPts=divide_curve.Points,
    VisualGeo=quad_remesh,
    ExportShape=Slider(10, range=0..10))
point_3 = Point(Point(0, 209.7928159, 68.21629944))
point_4 = Point(Point(0, -42, 39))
sofascene = SofaScene(
    Bodies=sofabody,
    Profiles=sofaprofiles.Profiles,
    CamPos=point_3,
    CamTarget=point_4,
    ProjDir=project_directory,
    Repo=repository,
    Write=write_sofascene)  # -> ScenePath, Info
sofaresults = SofaResults(ScenePath=sofascene.ScenePath, BodyName=body_name, Repo=repository, Refresh=refresh_sofaresults)  # -> Info, Times, Points, LastPts, PTimes, Pressures, CableNames, CableDisp, CableForce
frame = Slider(-1, range=-1..50)
refresh_sofashape = BooleanToggle(True)
point_5 = Point(sofaresults.Points)
list_item = ListItem(List=sofaresults.Points, Index=-1, Wrap=True)  # -> flatten(Item)
sofapreview = SofaPreview(ScenePath=sofascene.ScenePath, Repo=repository, Refresh=refresh_sofapreview)  # -> Volumes, Cavities, Regions, Targets, TendonCrvs, TendonChs, MonitorPts, FixBoxes, Info
# Preview for selected frame
sofashape = SofaShape(ScenePath=sofascene.ScenePath, BodyName=body_name, Frame=frame, Repo=repository, Refresh=refresh_sofashape)  # -> Mesh, NFrames, Time, Info
sofarun = SofaRun(ScenePath=sofascene.ScenePath, SofaRoot=runsofa_location, Repo=repository, Run=runsofa)
convex_hull_3d = ConvexHull3D(Points=list_item)  # -> Hull, Indices
# Preview for setup
panel_8 = Panel(sofarun)
